# Requirement set HLR (R2023a)

## 1 [#1] Summary (Informational)
The libs shall include two functions: Sum and Diff.

## 2 [#3] Sum
The lib shall support summing two numbers

## 3 [#4] Diff
The lib shall support differentiate two numbers.

## 4 [#2] Error handling (Informational)

## 5 [#5] Invalid inputs
If the inputs are not number, an error message shall be popped up.