# Requirement set LLR (R2023a)

## 1 [#3] Two functions
The lib shall contain two functions (Sum and Diff).

## 2 [#1] Sum function
The sum function shall sum up two inputs.

## 3 [#2] Diff function
The Diff function shall return the difference between the _first_ input and the second input.

## 4 [#4] Sum error
The Sum function shall generate an error "Invalid input" if any of the input is not a number.

## 5 [#5] Diff error
The Diff function shall generate an error "Invalid inputs" if any of the input is not a number.